# Dynamo graph Demo.dyn (Dynamo 1.3.1.1736)

code_block = CodeBlock { 4; }
noteOut = Dynamidi.Dynamidi.NoteOut(code_block)
watch = Watch(noteOut)
cc_channelOut = Dynamidi.Dynamidi.cc_channelOut()
watch_2 = Watch(cc_channelOut)
code_block_2 = CodeBlock { 1; }
cc_valueOut = Dynamidi.Dynamidi.cc_valueOut(code_block_2)
watch_3 = Watch(cc_valueOut)
code_block_3 = CodeBlock { 5; }
cc_controlOut = Dynamidi.Dynamidi.cc_controlOut(code_block_3)
watch_4 = Watch(cc_controlOut)
code_block_4 = CodeBlock { 0; }
controllerSetup = Dynamidi.Dynamidi.controllerSetup(code_block_4)
watch_5 = Watch(controllerSetup)
channelOut = Dynamidi.Dynamidi.channelOut()
watch_6 = Watch(channelOut)
code_block_5 = CodeBlock { 9; }
noteOut_2 = Dynamidi.Dynamidi.NoteOut(code_block_5)
watch_7 = Watch(noteOut_2)
